# Grasshopper definition 20221006_inclass_types_combinition.gh (Grasshopper 1.0.7)
# plug-ins: Bifocals

crv = Curve([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])
lng = ListLength(List=crv)

item = ListItem(List=crv, Index=Slider(0, range=0..15), Wrap=True)
item_2 = ListItem(List=crv, Index=Slider(0, range=0..15), Wrap=True)
item_3 = ListItem(List=crv, Index=Slider(11, range=0..15), Wrap=True)
item_4 = ListItem(List=crv, Index=Slider(9, range=0..15), Wrap=True)
pipe = Pipe(Curve=item, Radius=1, Caps=0)
pipe_2 = Pipe(Curve=item_2, Radius=1, Caps=0)
pipe_3 = Pipe(Curve=item_3, Radius=1, Caps=0)
pipe_4 = Pipe(Curve=item_4, Radius=1, Caps=0)

series = Series(Start=0, Step=1, Count=lng)
number_slider = Slider(145, range=0..256)
panel = Panel("""1
2
3
4
5""")
panel_2 = Panel("""X
Y
Z""")
panel_3 = Panel("""A
B
C
D""")
crossref = CrossReference(ListA=series, ListB=series, CrossMode=3)  # -> ListA, ListB

lng_2 = ListLength(List=crossref.ListB)
series_2 = Series(Start=0, Step=1, Count=lng_2)  # -> simplify(graft(Series))

crossref_2 = CrossReference(ListA=panel_2, ListB=panel_3, ListC=panel, CrossMode=3)  # -> ListA, ListB, ListC
panel_4 = Panel(crossref_2.ListA)
panel_5 = Panel(crossref_2.ListB)

item_5 = ListItem(List=crossref.ListB, Index=series_2, Wrap=True)
# 原有的排列選擇
item_6 = ListItem(List=crossref.ListA, Index=series_2, Wrap=True)

panel_6 = Panel(crossref_2.ListC)
merge = Merge(Data1=item_6, Data2=item_5)
number_slider_2 = Slider(11, range=0..100)
item_7 = ListItem(List=crv, Index=merge, Wrap=True)
panel_7 = Panel(item_7)
vec = VectorXYZ(XComponent=number_slider_2, YComponent=number_slider_2, ZComponent=0)  # -> Vector, Length

# ----
# 根據排列組，移動的數值
number_slider_3 = Slider(63, range=0..100)
multiplication = Multiplication(A=series_2, B=number_slider_3)
X = UnitX(Factor=multiplication)

move = Move(Geometry=item_7, Motion=X)  # -> Geometry, Transform
pipe_5 = Pipe(Curve=move.Geometry, Radius=1, Caps=0)
panel_8 = Panel(X)

sqrt = SquareRoot(Value=lng_2)
sqgrid = Square(Plane=PlaneXY(0, 0, 0), Size=Slider(45, range=0..100), ExtentX=sqrt, ExtentY=sqrt)  # -> flatten(Cells), Points
area = Area(Geometry=sqgrid.Cells)  # -> Area, simplify(graft(Centroid))

panel_9 = Panel(area.Centroid)
subtraction = Subtraction(A=area.Centroid, B=vec.Vector)

move_2 = Move(Geometry=item_7, Motion=subtraction)  # -> Geometry, Transform
