# Grasshopper definition changenamebylayer.gh (Grasshopper 1.0.7)

button = Button()
geo = Geometry()
panel = Panel("crv")  # disabled

# ----
# all layer
python = GhPythonScript(button=button)  # -> out, a; inputs button: Boolean
# ---------- python: Python ----------
__author__ = "chifu"
__version__ = "2022.04.09"

import rhinoscriptsyntax as rs
import scriptcontext as sc
import Rhino

#GH doc to Rhino doc
sc.doc = Rhino.RhinoDoc.ActiveDoc
##Rhino doc to GH doc
#sc.doc = ghdoc

a=sc.doc.Layers

for li in sc.doc.Layers:
    for i, obj in enumerate(sc.doc.Objects.FindByLayer(li.ToString())):
        if button:
            obj.Attributes.Name = li.ToString() + str(i)
            obj.CommitChanges()
#    print "Object identifier: ", obj
# ---------- end python ----------

# ----
# single layer
python_2 = GhPythonScript(button=button, layername=panel)  # -> out, a; inputs button: Boolean; disabled
# ---------- python_2: Python ----------
__author__ = "chifu"
__version__ = "2022.04.09"

import rhinoscriptsyntax as rs
import scriptcontext as sc
import Rhino

#GH doc to Rhino doc
sc.doc = Rhino.RhinoDoc.ActiveDoc
##Rhino doc to GH doc
#sc.doc = ghdoc

a=sc.doc.Layers

for i, obj in enumerate(sc.doc.Objects.FindByLayer(layername)):
    if button:
        obj.Attributes.Name = layername + str(i)
        obj.CommitChanges()
#    print "Object identifier: ", obj
# ---------- end python_2 ----------

panel_2 = Panel(python.a)
