# Grasshopper definition meshslop.gh (Grasshopper 1.0.7)
# plug-ins: Bifocals

mesh = Mesh(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)
demesh = DeconstructMesh(Mesh=mesh)  # -> Vertices, Faces, Colours, Normals

devec = DeconstructVector(Vector=demesh.Normals)  # -> XComponent, YComponent, ZComponent
gradient = Gradient(
    LowerLimit=0,
    UpperLimit=1,
    Parameter=devec.ZComponent,
    stops=[0.804: RGB(255, 0, 0), 0.881: RGB(255, 128, 0), 0.96: RGB(255, 255, 0), 1: RGB(0, 192, 0)])
mcol = MeshColours(Mesh=mesh, Colours=gradient)

number_slider = Slider(10, range=0..10)
Z = UnitZ(Factor=demesh.Normals)
# 顯示Z垂直向量、與法線向量
multiplication = Multiplication(A=Z, B=number_slider)
# 顯示斜度：法線向量 Z 值越高，表示越平緩
multiplication_2 = Multiplication(A=demesh.Normals, B=number_slider)
vdis = VectorDisplay(Anchor=demesh.Vertices, Vector=multiplication)
vdis_2 = VectorDisplay(Anchor=demesh.Vertices, Vector=multiplication_2)

xz = XZPlane(Origin=Point(0, 0, 0))
angle = Angle(VectorA=Z, VectorB=demesh.Normals, Plane=xz)  # -> Angle, Reflex
deg = Degrees(Radians=angle.Angle)

yz = YZPlane(Origin=Point(0, 0, 0))
angle_2 = Angle(VectorA=Z, VectorB=demesh.Normals, Plane=yz)  # -> Angle, Reflex
deg_2 = Degrees(Radians=angle_2.Angle)

subtraction = Subtraction(A=deg, B="180")
subtraction_2 = Subtraction(A=deg_2, B="180")
abs = Absolute(Value=subtraction)
abs_2 = Absolute(Value=subtraction_2)
subtraction_3 = Subtraction(A="180", B=abs)
subtraction_4 = Subtraction(A="180", B=abs_2)
# XZ
round = Round(Number=subtraction_3)  # -> Nearest, Floor, Ceiling
# YZ
round_2 = Round(Number=subtraction_4)  # -> Nearest, Floor, Ceiling

concat = Concatenate(FragmentA=round.Floor, FragmentB=",", FragmentC=round_2.Floor)

# ----
# 投影到XZ, YZ平面上的斜度
swatch = ColourSwatch(SwatchColor=RGB(255, 255, 255))
tag = TextTag(Location=demesh.Vertices, Text=concat, Colour=swatch)
