# Grasshopper definition typeplacement.gh (Grasshopper 1.0.7)
# plug-ins: Bifocals

# ----
# 物件類型
geo = Geometry(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)
geo_2 = Geometry(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)
geo_3 = Geometry(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)
merge = Merge(Data1=geo, Data2=geo_2, Data3=geo_3)

Z = UnitZ(Factor=Slider(36, range=0..80))
Z_2 = UnitZ(Factor=Slider(40, range=0..80))
Z_3 = UnitZ(Factor=Slider(22, range=0..80))
move = Move(Geometry=geo_2, Motion=Z_2)  # -> Geometry, Transform
move_2 = Move(Geometry=geo, Motion=Z)  # -> Geometry, Transform
move_3 = Move(Geometry=geo_3, Motion=Z_3)  # -> Geometry, Transform

# ----
# 找到要位移的向量
number_slider = Slider(2, range=0..10)
bbox = BoundingBox(Content=merge, Plane=PlaneXY(0, 0, 0), UnionBox=True)  # -> Box, Box_2
boxprop = BoxProperties(Box=bbox.Box)  # -> Center, Diagonal, Area, Volume, Degeneracy
devec = DeconstructVector(Vector=boxprop.Diagonal)  # -> XComponent, YComponent, ZComponent
recgrid = Rectangular(
    Plane=PlaneXY(0, 0, 0),
    SizeX=devec.XComponent,
    SizeY=devec.YComponent,
    ExtentX=number_slider,
    ExtentY=Slider(2, range=0..10))  # -> Cells, Points
area = Area(Geometry=recgrid.Cells)  # -> Area, flatten(Centroid)

# ----
# cross reference
# 基本模式
panel = Panel("""X
Y
Z""")
panel_2 = Panel("""A
B
C
D""")
crossref = CrossReference(ListA=panel, ListB=panel_2, CrossMode=1)  # -> ListA, ListB
panel_3 = Panel(crossref.ListB)
panel_4 = Panel(crossref.ListA)

lng = ListLength(List=merge)
series = Series(Start=0, Step=1, Count=lng)

# ----
# D
# 使用程式的寫法
number_slider_2 = Slider(53, range=0..100)
python = GhPythonScript(typegeo=merge, vecs=area.Centroid, coldist=number_slider_2, rowdist=number_slider_2)  # -> out, a; inputs typegeo: list, vecs: list of Point3d, coldist: Int32, rowdist: Int32
# ---------- python: Python ----------
__author__ = "chifu"
__version__ = "2021.11.26"

import rhinoscriptsyntax as rs
from Grasshopper.Kernel.Data import GH_Path
from Grasshopper import DataTree
import clr

clr.AddReference("Grasshopper")
dataTree = DataTree[object]()

for i in range(0,len(typegeo)):
    for j in range(0,len(typegeo)):
        for k in range(0,len(typegeo)):
            for l in range(0,len(typegeo)):
                path = GH_Path(k)
                xd = rs.CreateVector(coldist*j+(coldist*(len(typegeo)+1))*i,rowdist*k+(coldist*(len(typegeo)+1))*l,0)
                
                objs = rs.CopyObjects(typegeo[i],vecs[0]+xd)
                for obj, thing in enumerate(objs):
                    dataTree.Add(thing, path)
                    
                objs = rs.CopyObjects(typegeo[j],vecs[1]+xd)
                for obj, thing in enumerate(objs):
                    dataTree.Add(thing, path)
                    
                objs = rs.CopyObjects(typegeo[k],vecs[2]+xd)
                for obj, thing in enumerate(objs):
                    dataTree.Add(thing, path)
                
                objs = rs.CopyObjects(typegeo[l],vecs[3]+xd)
                for obj, thing in enumerate(objs):
                    dataTree.Add(thing, path)

a=dataTree
# ---------- end python ----------

# ----
# A
# 基本型 - 每次只顯示一組結果
crossref_2 = CrossReference(ListA=series, ListD=series, ListB=series, ListC=series, CrossMode=1)  # -> ListA, ListD, ListB, ListC
number_slider_3 = Slider(69, range=0..80)
item = ListItem(List=crossref_2.ListA, Index=number_slider_3, Wrap=True)
item_2 = ListItem(List=crossref_2.ListB, Index=number_slider_3, Wrap=True)
item_3 = ListItem(List=crossref_2.ListD, Index=number_slider_3, Wrap=True)
item_4 = ListItem(List=crossref_2.ListC, Index=number_slider_3, Wrap=True)
merge_2 = Merge(Data1=item, Data2=item_3, Data3=item_2, Data4=item_4)

item_5 = ListItem(List=merge, Index=merge_2, Wrap=True)
move_4 = Move(Geometry=item_5, Motion=area.Centroid)  # -> Geometry, Transform

# ----
# 排列組合
# - horistic 全部
# - diagonal 取消兩兩部分
# - coincident 取消重複
# 所有類型
# 選擇全體中的部分出來呈現
# 根據類型創造數列
crv = Curve([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])
lng_2 = ListLength(List=crv)
series_2 = Series(Start=0, Step=1, Count=lng_2)
panel_5 = Panel(lng_2)
number_slider_4 = Slider(43680, range=0..43680)
crossref_3 = CrossReference(ListA=series_2, ListB=series_2, ListC=series_2, ListD=series_2, CrossMode=3)  # -> ListA, ListB, ListC, ListD
panel_6 = Panel(crossref_3.ListA)
lng_3 = ListLength(List=crossref_3.ListA)
panel_7 = Panel(crossref_3.ListB)
panel_8 = Panel(crossref_3.ListC)
panel_9 = Panel(lng_3)
panel_10 = Panel(crossref_3.ListD)

item_6 = ListItem(List=crossref_3.ListA, Index=number_slider_4, Wrap=True)
item_7 = ListItem(List=crossref_3.ListC, Index=number_slider_4, Wrap=True)
item_8 = ListItem(List=crossref_3.ListB, Index=number_slider_4, Wrap=True)
item_9 = ListItem(List=crossref_3.ListD, Index=number_slider_4, Wrap=True)

merge_3 = Merge(Data1=item_6, Data2=item_8, Data3=item_7, Data4=item_9)

item_10 = ListItem(List=crv, Index=merge_3, Wrap=True)
pipe = Pipe(Curve=item_10, Radius=Slider(0.5, range=0..1), Caps="2")

preview = CustomPreview(Geometry=pipe, Material=ColourSwatch(SwatchColor=RGB(30, 35, 255)))

# ----
# C
# 繪製一個格點組
# 將格點組 對應到每組位移量
crossref_4 = CrossReference(ListA=series, ListD=series, ListB=series, ListC=series, CrossMode=1)  # -> ListA, ListD, ListB, ListC

lng_4 = ListLength(List=crossref_4.ListC)
series_3 = Series(Start=0, Step=1, Count=lng_4)  # -> simplify(graft(Series))
item_11 = ListItem(List=crossref_4.ListA, Index=series_3, Wrap=True)
item_12 = ListItem(List=crossref_4.ListD, Index=series_3, Wrap=True)
item_13 = ListItem(List=crossref_4.ListB, Index=series_3, Wrap=True)
item_14 = ListItem(List=crossref_4.ListC, Index=series_3, Wrap=True)
merge_4 = Merge(Data1=item_11, Data2=item_12, Data3=item_13, Data4=item_14)

item_15 = ListItem(List=merge, Index=merge_4, Wrap=True)

sqrt = SquareRoot(Value=lng_4)
sqgrid = Square(Plane=PlaneXY(0, 0, 0), Size=Slider(55, range=0..100), ExtentX=sqrt, ExtentY=sqrt)  # -> flatten(Cells), simplify(Points)
area_2 = Area(Geometry=sqgrid.Cells)  # -> Area, simplify(graft(Centroid))
addition = Addition(A=area.Centroid, B=area_2.Centroid)  # -> simplify(Result)

move_5 = Move(Geometry=item_15, Motion=addition)  # -> Geometry, Transform
tag = TextTag(Location=area_2.Centroid, Text=series_3)

# ----
# B
# 所有結果列印型 -
# 每組都執行 ，需要使用數列
# 並且將執行結果向X方向移動
# 每組位移 X 方向
crossref_5 = CrossReference(ListA=series, ListD=series, ListB=series, ListC=series, CrossMode=1)  # -> ListA, ListD, ListB, ListC

lng_5 = ListLength(List=crossref_5.ListC)
series_4 = Series(Start=0, Step=1, Count=lng_5)  # -> simplify(graft(Series))
item_16 = ListItem(List=crossref_5.ListD, Index=series_4, Wrap=True)
item_17 = ListItem(List=crossref_5.ListA, Index=series_4, Wrap=True)
item_18 = ListItem(List=crossref_5.ListB, Index=series_4, Wrap=True)
item_19 = ListItem(List=crossref_5.ListC, Index=series_4, Wrap=True)
merge_5 = Merge(Data1=item_17, Data2=item_16, Data3=item_18, Data4=item_19)

multiplication = Multiplication(A=Slider(55, range=0..100), B=series_4)
vec = VectorXYZ(XComponent=multiplication, YComponent=0, ZComponent=0)  # -> Vector, Length
addition_2 = Addition(A=area.Centroid, B=vec.Vector)

item_20 = ListItem(List=merge, Index=merge_5, Wrap=True)
move_6 = Move(Geometry=item_20, Motion=addition_2)  # -> Geometry, Transform
