# Grasshopper definition wasp.gh (Grasshopper 1.0.7)
# plug-ins: Bifocals

geo = Geometry(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)

# ----
# 基本元件型(GEO)
# 銜接點(CONN)
# 銜接方向
number_slider = Slider(7, range=0..10)
# 規則
geo_2 = Geometry(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)
pt = Point([Point(8.660254038, -15, 10), Point(8.660254038, 15, 10), Point(-17.32050808, 0, 10)])
crv = Curve([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])
points = PointList(Points=pt, Size=number_slider)
conndir = Wasp_ConnectionFromDirection(GEO=geo_2, CEN=pt, UP=crv)  # -> CONN, PLN_OUT; inputs CEN: list of Point3d, UP: list of Curve, T: list; plug-in component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
# wasp basic part A
part = Wasp_BasicPart(NAME="A", GEO=geo_2, CONN=flatten(conndir.CONN))  # -> PART; inputs GEO: Mesh, CONN: list, COLL: Mesh, ATTR: list; plug-in component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

# ----
# 基本元件型(GEO)
# 銜接點(CONN)
# 銜接方向
number_slider_2 = Slider(7, range=0..10)
geo_3 = Geometry(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)
pt_2 = Point([Point(57.64455969, -10.00000208, 10), Point(77.64455969, -10.00000208, 10)])
crv_2 = Curve([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])
points_2 = PointList(Points=pt_2, Size=number_slider_2)
conndir_2 = Wasp_ConnectionFromDirection(GEO=geo_3, CEN=pt_2, UP=crv_2)  # -> CONN, PLN_OUT; inputs CEN: list of Point3d, UP: list of Curve, T: list; plug-in component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
# wasp basic part B
panel = Panel("B")
part_2 = Wasp_BasicPart(NAME=panel, GEO=geo_3, CONN=flatten(conndir_2.CONN))  # -> PART; inputs GEO: Mesh, CONN: list, COLL: Mesh, ATTR: list; plug-in component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

# ----
# 找到 每個面的 plane
debrep = DeconstructBrep(Brep=geo)  # -> Faces, Edges, Vertices
# 沿 surface 生長
area = Area(Geometry=debrep.Faces)  # -> Area, simplify(graft(Centroid))
facen = FaceNormals(Mesh=debrep.Faces)  # -> Centers, simplify(Normals)
pl = PlaneNormal(Origin=area.Centroid, ZAxis=facen.Normals)

# ----
# 沿範圍生長 (擬合)
# 原型
geo_4 = Geometry(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)

pt_3 = Point([Point(8.660254038, -15, 10), Point(8.660254038, 15, 10), Point(-17.32050808, 0, 10)])
points_3 = PointList(Points=pt_3, Size=Slider(7, range=0..10))

# ----
# 單一元件
# 基本元件型(GEO)
geo_5 = Geometry(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)

# ----
# 銜接點(CONN)
# 銜接方向
crv_3 = Curve([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])
conndir_3 = Wasp_ConnectionFromDirection(GEO=geo_5, CEN=pt_3, UP=crv_3)  # -> CONN, PLN_OUT; inputs CEN: list of Point3d, UP: list of Curve, T: list; plug-in component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

geo_6 = Geometry(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)
attribute = Wasp_Attribute(ID="detial", VAL=geo_6, TR=Toggle(True))  # -> ATTR; inputs VAL: list, TR: Boolean; plug-in component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

# ----
# 基本元件型(GEO)
# 銜接點(CONN)
# 銜接方向
number_slider_3 = Slider(7, range=0..10)
geo_7 = Geometry(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)
pt_4 = Point([Point(57.64455969, -10.00000208, 10), Point(77.64455969, -10.00000208, 10)])
crv_4 = Curve([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])
points_4 = PointList(Points=pt_4, Size=number_slider_3)
conndir_4 = Wasp_ConnectionFromDirection(GEO=geo_7, CEN=pt_4, UP=crv_4)  # -> CONN, PLN_OUT; inputs CEN: list of Point3d, UP: list of Curve, T: list; plug-in component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
# wasp basic part B
part_3 = Wasp_BasicPart(NAME="B", GEO=geo_7, CONN=flatten(conndir_4.CONN), ATTR=attribute)  # -> PART; inputs GEO: Mesh, CONN: list, COLL: Mesh, ATTR: list; plug-in component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

toggle = BooleanToggle(True)

geo_8 = Geometry(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)
attribute_2 = Wasp_Attribute(ID="detial", VAL=geo_8, TR=Toggle(True))  # -> ATTR; inputs VAL: list, TR: Boolean; plug-in component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

# ----
# 基本元件型(GEO)
# 銜接點(CONN)
# 銜接方向
number_slider_4 = Slider(7, range=0..10)
# 多元件 + 細節
geo_9 = Geometry(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)
pt_5 = Point([Point(8.660254038, -15, 10), Point(8.660254038, 15, 10), Point(-17.32050808, 0, 10)])
crv_5 = Curve([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])
points_5 = PointList(Points=pt_5, Size=number_slider_4)
conndir_5 = Wasp_ConnectionFromDirection(GEO=geo_9, CEN=pt_5, UP=crv_5)  # -> CONN, PLN_OUT; inputs CEN: list of Point3d, UP: list of Curve, T: list; plug-in component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
# wasp basic part A
part_4 = Wasp_BasicPart(NAME="A", GEO=geo_9, CONN=flatten(conndir_5.CONN), ATTR=attribute_2)  # -> PART; inputs GEO: Mesh, CONN: list, COLL: Mesh, ATTR: list; plug-in component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

brep = Brep(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)

number_slider_5 = Slider(1.3, range=0..10)
bbox = BoundingBox(Content=brep, Plane=PlaneXY(0, 0, 0))  # -> Box, Box_2
area_2 = Area(Geometry=bbox.Box)  # -> Area, Centroid
scale_nu = ScaleNU(Geometry=bbox.Box, Plane=area_2.Centroid, ScaleX=number_slider_5, ScaleY=number_slider_5, ScaleZ=number_slider_5)  # -> Geometry, Transform

# ----
# wasp basic part
panel_2 = Panel("hex")
part_5 = Wasp_BasicPart(NAME=panel_2, GEO=geo_5, CONN=flatten(conndir_3.CONN))  # -> PART; inputs GEO: Mesh, CONN: list, COLL: Mesh, ATTR: list; plug-in component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

connpln = Wasp_ConnectionFromPlane(PLN=pl)  # -> CONN, PLN_OUT; inputs PLN: list of Plane, T: list; plug-in component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

points_6 = PointList(Points=flatten(area.Centroid), Size=Slider(7, range=0..10))
cull_i = CullIndex(List=flatten(connpln.CONN), Indices="2", Wrap=True)

# ----
# 找擬合範圍內的可能權重
crv_6 = Curve(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)
# 根據元件大小定義 可能範圍的 res
# 值越大，格點尺寸 越大
number_slider_6 = Slider(12, range=0..100)

number_slider_7 = Slider(1.3, range=0..10)
bbox_2 = BoundingBox(Content=crv_6, Plane=PlaneXY(0, 0, 0))  # -> Box, Box_2
# 找路徑範圍
area_3 = Area(Geometry=bbox_2.Box)  # -> Area, Centroid
scale_nu_2 = ScaleNU(Geometry=bbox_2.Box, Plane=area_3.Centroid, ScaleX=number_slider_7, ScaleY=number_slider_7, ScaleZ=number_slider_7)  # -> Geometry, Transform

toggle_2 = BooleanToggle(True)

merge = Merge(Data1=part, Data2=part_2)
# wasp rule
rulegen = Wasp_RulesGenerator(PART=part_5)  # -> R; inputs PART: list, SELF_P: Boolean, SELF_C: Boolean, TYP: Boolean, GR: list; plug-in component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
merge_2 = Merge(Data1=part_4, Data2=part_3)
# wasp rule
rulegen_2 = Wasp_RulesGenerator(PART=merge_2)  # -> R; inputs PART: list, SELF_P: Boolean, SELF_C: Boolean, TYP: Boolean, GR: list; plug-in component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
# 根據元件大小定義 可能範圍的 res
# 值越大，格點尺寸 越大
number_slider_8 = Slider(60, range=0..100)

# ----
# wasp rule
panel_3 = Panel("A")
rule = Wasp_Rule(P1=panel_3, C1="1", P2="B", C2="0")  # -> R; inputs C1: Int32, C2: Int32; plug-in component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

fieldpts = Wasp_FieldPoints(BOU=scale_nu.Geometry, RES=number_slider_6)  # -> E_FIELD, PTS; inputs BOU: list of Mesh; plug-in component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

# ----
# wasp rule text
panel_4 = Panel("""A|0_B|0
A|1_B|0
B|0_B|1
B|1_B|0
B|1_A|2
A|0_A|1
A|1_B|0""")
ruletxt = Wasp_RuleFromText(TXT=panel_4)  # -> R; plug-in component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

# ----
# wasp rule generator
toggle_3 = BooleanToggle(True)
rulegen_3 = Wasp_RulesGenerator(PART=merge, SELF_P=toggle_3, SELF_C=Toggle(False), TYP=Toggle(True))  # -> R; inputs PART: list, SELF_P: Boolean, SELF_C: Boolean, TYP: Boolean, GR: list; plug-in component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

geo_10 = Geometry(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)
attribute_3 = Wasp_Attribute(ID="part", VAL=geo_10, TR=toggle_2)  # -> ATTR; inputs VAL: list, TR: Boolean; plug-in component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
part_6 = Wasp_BasicPart(NAME="A", GEO=geo, CONN=flatten(cull_i), ATTR=attribute_3)  # -> PART; inputs GEO: Mesh, CONN: list, COLL: Mesh, ATTR: list; plug-in component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

geo_11 = Geometry(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)
attribute_4 = Wasp_Attribute(ID="part", VAL=geo_11, TR=toggle_2)  # -> ATTR; inputs VAL: list, TR: Boolean; plug-in component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
part_7 = Wasp_BasicPart(NAME="B", GEO=geo, CONN=flatten(cull_i), ATTR=attribute_4)  # -> PART; inputs GEO: Mesh, CONN: list, COLL: Mesh, ATTR: list; plug-in component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

geo_12 = Geometry(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)
attribute_5 = Wasp_Attribute(ID="part", VAL=geo_12, TR=toggle_2)  # -> ATTR; inputs VAL: list, TR: Boolean; plug-in component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
part_8 = Wasp_BasicPart(NAME="C", GEO=geo, CONN=flatten(cull_i), ATTR=attribute_5)  # -> PART; inputs GEO: Mesh, CONN: list, COLL: Mesh, ATTR: list; plug-in component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

# ----
# wasp aggregation
stochasticaggregation = Wasp_StochasticAggregation(PART=flatten(part_5), N=Slider(45, range=0..100), RULES=rulegen)  # -> AGGR, PART_OUT; inputs PART: list, PREV: list, N: Int32, RULES: list, MODE: Int32, GC: list, RESET: Boolean; plug-in component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
# wasp aggregation
stochasticaggregation_2 = Wasp_StochasticAggregation(PART=flatten(merge_2), N=Slider(86, range=0..100), RULES=rulegen_2, RESET=Button())  # -> AGGR, PART_OUT; inputs PART: list, PREV: list, N: Int32, RULES: list, MODE: Int32, GC: list, RESET: Boolean; plug-in component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
fieldpts_2 = Wasp_FieldPoints(BOU=scale_nu_2.Geometry, RES=number_slider_8)  # -> E_FIELD, PTS; inputs BOU: list of Mesh; plug-in component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
panel_5 = Panel(rule)

# ----
# 尋找格點中每點與擬合線的距離後
# 依遠近顯示
pull = PullPoint(Point=fieldpts.PTS, Geometry=brep, ClosestOnly=True)  # -> ClosestPoint, Distance
bnd = Bounds(Numbers=pull.Distance)
remap = RemapNumbers(Value=pull.Distance, Source=bnd, Target="1 to 0")  # -> Mapped, Clipped
graph = GraphMapper(remap.Mapped, x0=0, x1=1, y0=0, y1=1, Cx=0.8308958411, Cy=0.2276611328, container_name="Conic")

# ----
# wasp get part geo
partgeo = Wasp_GetPartGeometry(PART=stochasticaggregation.PART_OUT)  # -> GEO; plug-in component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

# ----
# 尋找格點中每點與擬合線的距離後
# 依遠近顯示
pull_2 = PullPoint(Point=fieldpts_2.PTS, Geometry=crv_6, ClosestOnly=True)  # -> ClosestPoint, Distance
bnd_2 = Bounds(Numbers=pull_2.Distance)
remap_2 = RemapNumbers(Value=pull_2.Distance, Source=bnd_2, Target="1 to 0")  # -> Mapped, Clipped
graph_2 = GraphMapper(remap_2.Mapped, x0=0, x1=1, y0=0, y1=1, Cx=0.7250109911, Cy=0.2133187652, container_name="Conic")

# ----
# get attribute by name
namefilter = Wasp_FilterPartsByName(PART=stochasticaggregation_2.PART_OUT, NAME="B")  # -> PART_OUT, MASK; inputs PART: list, NAME: list; plug-in component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
# filter by name
# wasp get part geo
namefilter_2 = Wasp_FilterPartsByName(PART=stochasticaggregation_2.PART_OUT, NAME="A")  # -> PART_OUT, MASK; inputs PART: list, NAME: list; plug-in component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
partgeo_2 = Wasp_GetPartGeometry(PART=namefilter.PART_OUT)  # -> GEO; plug-in component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
partgeo_3 = Wasp_GetPartGeometry(PART=namefilter_2.PART_OUT)  # -> GEO; plug-in component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

panel_6 = Panel(rulegen_3)
# wasp aggregation
stochasticaggregation_3 = Wasp_StochasticAggregation(PART=flatten(merge), N=Slider(100, range=0..100), RULES=rulegen_3, RESET=Button())  # -> AGGR, PART_OUT; inputs PART: list, PREV: list, N: Int32, RULES: list, MODE: Int32, GC: list, RESET: Boolean; plug-in component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

getattr = Wasp_GetAttributeByName(PART=namefilter.PART_OUT, ID="detial")  # -> VAL; plug-in component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
getattr_2 = Wasp_GetAttributeByName(PART=namefilter_2.PART_OUT, ID="detial")  # -> VAL; plug-in component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

# ----
# wasp field
field = Wasp_Field(NAME="alongcrv", E_FIELD=fieldpts_2.E_FIELD, VAL=graph_2)  # -> FIELD; inputs VAL: list; plug-in component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

gradient = Gradient(LowerLimit=0, UpperLimit=1, Parameter=graph, stops=[0: RGB(0, 192, 0), 0.248: RGB(255, 255, 0), 1: RGB(220, 0, 40)])
merge_3 = Merge(Data1=part_6, Data2=part_7, Data3=part_8)

namefilter_3 = Wasp_FilterPartsByName(PART=stochasticaggregation_3.PART_OUT, NAME=panel)  # -> PART_OUT, MASK; inputs PART: list, NAME: list; plug-in component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
# filter by name
namefilter_4 = Wasp_FilterPartsByName(PART=stochasticaggregation_3.PART_OUT, NAME="A")  # -> PART_OUT, MASK; inputs PART: list, NAME: list; plug-in component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
# wasp get part geo
partgeo_4 = Wasp_GetPartGeometry(PART=namefilter_3.PART_OUT)  # -> GEO; plug-in component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
partgeo_5 = Wasp_GetPartGeometry(PART=namefilter_4.PART_OUT)  # -> GEO; plug-in component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

gradient_2 = Gradient(LowerLimit=0, UpperLimit=1, Parameter=graph_2, stops=[0: RGB(0, 192, 0), 0.248: RGB(255, 255, 0), 1: RGB(220, 0, 40)])

# ----
# wasp field
field_2 = Wasp_Field(NAME="volume", E_FIELD=fieldpts.E_FIELD, VAL=graph)  # -> FIELD; inputs VAL: list; plug-in component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

preview = CustomPreview(Geometry=fieldpts_2.PTS, Material=gradient_2)
preview_2 = CustomPreview(Geometry=fieldpts.PTS, Material=gradient)
# wasp rule
rulegen_4 = Wasp_RulesGenerator(PART=merge_3, SELF_P=Toggle(False), SELF_C=Toggle(False), TYP=Toggle(False))  # -> R; inputs PART: list, SELF_P: Boolean, SELF_C: Boolean, TYP: Boolean, GR: list; plug-in component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
# wasp field driven
number_slider_9 = Slider(200, range=0..1000)
fieldaggregation = Wasp_FieldDrivenAggregation(PART=flatten(merge_3), N=number_slider_9, RULES=rulegen_4, FIELD=field_2, RESET=Button())  # -> AGGR, PART_OUT; inputs PART: list, PREV: list, N: Int32, RULES: list, FIELD: list, MODE: Int32, GC: list, RESET: Boolean; plug-in component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
partgeo_6 = Wasp_GetPartGeometry(PART=fieldaggregation.PART_OUT)  # -> GEO; plug-in component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
getattr_3 = Wasp_GetAttributeByName(PART=fieldaggregation.PART_OUT, ID="part")  # -> VAL; plug-in component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

debrep_2 = DeconstructBrep(Brep=geo_4)  # -> Faces, Edges, Vertices
area_4 = Area(Geometry=debrep_2.Faces)  # -> Area, simplify(graft(Centroid))
facen_2 = FaceNormals(Mesh=debrep_2.Faces)  # -> Centers, simplify(Normals)

item = ListItem(List=facen_2.Normals, Index="0", Wrap=True)

pl_2 = PlaneNormal(Origin=area_4.Centroid, ZAxis=item)

points_7 = PointList(Points=flatten(pl_2), Size=Slider(7, range=0..10))

# ----
# 找到 每個面的 plane
# !!! 資料結構需求
connpln_2 = Wasp_ConnectionFromPlane(PLN=pl_2)  # -> CONN, PLN_OUT; inputs PLN: list of Plane, T: list; plug-in component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
part_9 = Wasp_BasicPart(NAME="hex", GEO=geo_4, CONN=flatten(connpln_2.CONN))  # -> PART; inputs GEO: Mesh, CONN: list, COLL: Mesh, ATTR: list; plug-in component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

# ----
# wasp rule
rulegen_5 = Wasp_RulesGenerator(PART=part_9)  # -> R; inputs PART: list, SELF_P: Boolean, SELF_C: Boolean, TYP: Boolean, GR: list; plug-in component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
# wasp field driven
fieldaggregation_2 = Wasp_FieldDrivenAggregation(PART=flatten(part_9), N=Slider(300, range=0..1000), RULES=rulegen_5, FIELD=field, RESET=Button())  # -> AGGR, PART_OUT; inputs PART: list, PREV: list, N: Int32, RULES: list, FIELD: list, MODE: Int32, GC: list, RESET: Boolean; plug-in component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
partgeo_7 = Wasp_GetPartGeometry(PART=fieldaggregation_2.PART_OUT)  # -> GEO; plug-in component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
